# Grasshopper definition 0429_fractalBrownianMotion_工作坊紀錄.gh (Grasshopper 1.0.7)
# plug-ins: Bifocals

trigger = Trigger(Interval=20, TimerInterval=20, Target=c_script)  # disabled
c_script = CSharpScript(reset=Toggle(False), span=Slider(0.029, range=0..1))  # -> out, T; inputs reset: Boolean, span: Double
# ---------- c_script: C# ----------
    if(reset) t = 0;
    else t += span;
    T = t;
# ---------- c_script: C# additional code ----------
  double t = 0;
# ---------- end c_script ----------

# ----
# multi wave motion
number_slider = Slider(2, range=0..10)
# polar coordinates
# 
# x = r*cos(theta)
# y = r*sin(theta)
number_slider_2 = Slider(2, range=0..10)
# r = amp*sin(n*theta+t)+k
# t++
number_slider_3 = Slider(2, range=0..10)
# r = amp*cos(n*theta)
number_slider_4 = Slider(2, range=0..10)
# r = amp*sin(n*theta+initT)
# multi
number_slider_5 = Slider(2, range=0..10)
# multi wave
number_slider_6 = Slider(2, range=0..10)
# r = amp*sin(n*theta)+k
number_slider_7 = Slider(2, range=0..10)
# r = amp*sin(n*theta+(t+initT)*speed)
# multi
number_slider_8 = Slider(2, range=0..10)
# y =cos(theta)
number_slider_9 = Slider(100, range=0..100)
# y = sin(theta)
pi = Pi(Factor=Slider(2, range=0..10))
# y = amp*sin(n*theta)
pi_2 = Pi(Factor=Slider(2, range=0..10))
# y = sin(n*theta)
pi_3 = Pi(Factor=Slider(2, range=0..10))
pi_4 = Pi(Factor=number_slider)
pi_5 = Pi(Factor=Slider(2, range=0..10))

trigger_2 = Trigger(Interval=20, TimerInterval=20, Target=c_script_2)  # disabled
c_script_2 = CSharpScript(reset=Toggle(False), span=Slider(0.024, range=0..1))  # -> out, T; inputs reset: Boolean, span: Double; same code as c_script

# ----
# r = amp*sin(n*theta)
number_slider_10 = Slider(100, range=0..100)
pi_6 = Pi(Factor=number_slider_2)
pi_7 = Pi(Factor=Slider(2, range=0..10))
pi_8 = Pi(Factor=number_slider_3)
pi_9 = Pi(Factor=number_slider_4)
pi_10 = Pi(Factor=number_slider_5)
pi_11 = Pi(Factor=number_slider_6)
dom = ConstructDomain(DomainStart=0, DomainEnd=pi)
pi_12 = Pi(Factor=number_slider_7)
dom_2 = ConstructDomain(DomainStart=0, DomainEnd=pi_2)
dom_3 = ConstructDomain(DomainStart=0, DomainEnd=pi_3)
dom_4 = ConstructDomain(DomainStart=0, DomainEnd=pi_4)
dom_5 = ConstructDomain(DomainStart=0, DomainEnd=pi_5)
pi_13 = Pi(Factor=number_slider_8)
pi_14 = Pi(Factor=Slider(2, range=0..10))
dom_6 = ConstructDomain(DomainStart=0, DomainEnd=pi_6)
dom_7 = ConstructDomain(DomainStart=0, DomainEnd=pi_7)
dom_8 = ConstructDomain(DomainStart=0, DomainEnd=pi_8)
dom_9 = ConstructDomain(DomainStart=0, DomainEnd=pi_9)
dom_10 = ConstructDomain(DomainStart=0, DomainEnd=pi_10)
dom_11 = ConstructDomain(DomainStart=0, DomainEnd=pi_11)
dom_12 = ConstructDomain(DomainStart=0, DomainEnd=pi_12)
dom_13 = ConstructDomain(DomainStart=0, DomainEnd=pi_13)
dom_14 = ConstructDomain(DomainStart=0, DomainEnd=pi_14)

# ---- group: theta
range = Range(Domain=dom, Steps=number_slider_9)

range_2 = Range(Domain=dom_2, Steps=Slider(100, range=0..100))

range_3 = Range(Domain=dom_3, Steps=Slider(100, range=0..100))

# ---- group: Multiplication
multiplication = Multiplication(A=range_3, B=Slider(0, range=0..10))

# ---- group: theta
range_4 = Range(Domain=dom_4, Steps=Slider(100, range=0..100))

range_5 = Range(Domain=dom_5, Steps=Slider(100, range=0..100))

# ----
trigger_3 = Trigger(Interval=20, TimerInterval=20, Target=c_script_3)  # disabled
c_script_3 = CSharpScript(reset=Toggle(False), span=Slider(0.057, range=0..1))  # -> out, T; inputs reset: Boolean, span: Double; same code as c_script

trigger_4 = Trigger(Interval=20, TimerInterval=20, Target=c_script_4)  # disabled
c_script_4 = CSharpScript(reset=Toggle(False), span=Slider(0.065, range=0..1))  # -> out, T; inputs reset: Boolean, span: Double; same code as c_script

# ---- group: theta
range_6 = Range(Domain=dom_6, Steps=number_slider_10)

range_7 = Range(Domain=dom_7, Steps=Slider(100, range=0..100))

# ----
multiplication_2 = Multiplication(A=range_7, B=Slider(0, range=0..10))

# ---- group: theta
range_8 = Range(Domain=dom_8, Steps=Slider(100, range=0..100))

range_9 = Range(Domain=dom_9, Steps=Slider(100, range=0..100))

# ----
multiplication_3 = Multiplication(A=range_9, B=Slider(0, range=0..10))

# ---- group: theta
range_10 = Range(Domain=dom_10, Steps=Slider(100, range=0..100))

# ----
multiplication_4 = Multiplication(A=range_2, B=Slider(5, range=0..10))

# ---- group: theta
range_11 = Range(Domain=dom_11, Steps=Slider(100, range=0..100))

# ----
trigger_5 = Trigger(Interval=20, TimerInterval=20, Target=c_script_5)  # disabled
c_script_5 = CSharpScript(reset=Toggle(False), span=Slider(0.109, range=0..1))  # -> out, T; inputs reset: Boolean, span: Double; same code as c_script

# ---- group: theta
range_12 = Range(Domain=dom_12, Steps=Slider(100, range=0..100))

# ----
number_slider_11 = Slider(2000, range=0..10000)

# ---- group: theta
range_13 = Range(Domain=dom_13, Steps=Slider(100, range=0..100))

# ----
sin = Sine(Value=multiplication_2)

multiplication_5 = Multiplication(A=sin, B=Slider(1.08, range=0..10))

cos = Cosine(Value=multiplication_3)

multiplication_6 = Multiplication(A=cos, B=Slider(1.08, range=0..10))

# ---- group: theta
range_14 = Range(Domain=dom_14, Steps=Slider(100, range=0..100))

# ----
panel = Panel(range_6)
addition = Addition(A=range_8, B=c_script_2.T)
sin_2 = Sine(Value=range)
cos_2 = Cosine(Value=range_5)
sin_3 = Sine(Value=multiplication_4)

multiplication_7 = Multiplication(A=sin_3, B=Slider(0, range=0..10))

sin_4 = Sine(Value=range_6)
cos_3 = Cosine(Value=range_6)
sin_5 = Sine(Value=multiplication)
sin_6 = Sine(Value=range_7)
cos_4 = Cosine(Value=range_7)
sin_7 = Sine(Value=range_9)
cos_5 = Cosine(Value=range_9)
multiplication_8 = Multiplication(A=range_12, B=Slider(0, range=0..10))
merge = Merge(Data1=Slider(1.44, range=0..10), Data2=Slider(0, range=0..10), Data3=Slider(0.86, range=0..10))
merge_2 = Merge(Data1=Slider(1.71, range=0..10), Data2=Slider(1.8, range=0..10), Data3=Slider(0.64, range=0..10))
merge_3 = Merge(Data1=Slider(1.43, range=0..10), Data2=Slider(1.19, range=0..10), Data3=Slider(0.92, range=0..10))
merge_4 = Merge(Data1=Slider(43.81, range=0..100), Data2=Slider(23, range=0..100), Data3=Slider(14.74, range=0..100))
merge_5 = Merge(Data1=Slider(43.81, range=0..100), Data2=Slider(29.12, range=0..100), Data3=Slider(46.02, range=0..100))
# r = amp*sin(n*theta+initT)
# code
number_slider_12 = Slider(1.19, range=0..10)
merge_6 = Merge(Data1=Slider(1, range=0..10), Data2=Slider(3, range=0..10), Data3=Slider(5, range=0..10))
merge_7 = Merge(Data1=Slider(1, range=0..10), Data2=Slider(9, range=0..10), Data3=Slider(5, range=0..10))
merge_8 = Merge(Data1=Slider(1.71, range=0..10), Data2=Slider(1.8, range=0..10), Data3=Slider(0.64, range=0..10))
merge_9 = Merge(Data1=Slider(43.81, range=0..100), Data2=Slider(29.12, range=0..100), Data3=Slider(64.38, range=0..100))
merge_10 = Merge(Data1=Slider(1, range=0..10), Data2=Slider(3, range=0..10), Data3=Slider(6, range=0..10))
merge_11 = Merge(Data1=Slider(1.43, range=0..10), Data2=Slider(1.19, range=0..10), Data3=Slider(3.56, range=0..10))
sin_8 = Sine(Value=multiplication_8)

multiplication_9 = Multiplication(A=sin_8, B=Slider(1.25, range=0..10))

merge_12 = Merge(Data1=Slider(43.81, range=0..100), Data2=Slider(29.12, range=0..100), Data3=Slider(64.38, range=0..100))
merge_13 = Merge(Data1=Slider(1, range=0..10), Data2=Slider(9, range=0..10), Data3=Slider(5, range=0..10))
multiplication_10 = Multiplication(A=multiplication_5, B=Slider(2000, range=0..10000))
multiplication_11 = Multiplication(A=multiplication_6, B=Slider(2000, range=0..10000))
panel_2 = Panel(sin_4)
multiplication_12 = Multiplication(A=cos_3, B=number_slider_11)
multiplication_13 = Multiplication(A=sin_4, B=number_slider_11)
multiplication_14 = Multiplication(A=cos_4, B=multiplication_10)
neg = Negative(Value=c_script_3.T)
multiplication_15 = Multiplication(A=sin_6, B=multiplication_10)
multiplication_16 = Multiplication(A=cos_5, B=multiplication_11)
multiplication_17 = Multiplication(A=sin_7, B=multiplication_11)
pt = ConstructPoint(XCoordinate=range, YCoordinate=sin_2, ZCoordinate=0)
pt_2 = ConstructPoint(XCoordinate=range_2, YCoordinate=multiplication_7, ZCoordinate=0)
pt_3 = ConstructPoint(XCoordinate=range_3, YCoordinate=sin_5, ZCoordinate=0)
pt_4 = ConstructPoint(XCoordinate=range_5, YCoordinate=cos_2, ZCoordinate=0)
neg_2 = Negative(Value=c_script_4.T)
multiplication_18 = Multiplication(A=addition, B=Slider(6, range=0..10))
c_script_6 = CSharpScript(x=range_10, amp=merge_2, freq=merge_6, initT=merge_4)  # -> out, A; inputs x: Double, amp: list of Double, freq: list of Int32, initT: list of Double
# ---------- c_script_6: C# ----------
  
    double y = 0.0;
    //Print(amp.Count.ToString());
    for(int i = 0;i < amp.Count;i++){
      y+=amp[i] * Math.Sin(freq[i] * x + initT[i]);
    
    }
    A = y;
# ---------- end c_script_6 ----------
c_script_7 = CSharpScript(x=range_4, amp=merge_3, freq=merge_7, initT=merge_5, T=neg, speed=merge)  # -> out, A; inputs x: Double, amp: list of Double, freq: list of Int32, initT: list of Double, T: Double, speed: list of Double
# ---------- c_script_7: C# ----------
    double y = 0.0;
    //Print(amp.Count.ToString());
    for(int i = 0;i < amp.Count;i++){
      y += amp[i] * Math.Sin(freq[i] * (x + initT[i] + (T*speed[i])));

    }
    A = y;
# ---------- end c_script_7 ----------
c_script_8 = CSharpScript(x=range_14, amp=number_slider_12, freq=Slider(2, range=0..10), initT=Slider(0, range=0..30))  # -> out, A; inputs x: Double, amp: Double, freq: Int32, initT: Double
# ---------- c_script_8: C# ----------
  
    A = amp * Math.Sin(freq * x + initT);
# ---------- end c_script_8 ----------
neg_3 = Negative(Value=c_script_5.T)
c_script_9 = CSharpScript(x=range_13, amp=merge_8, freq=merge_10, initT=merge_9, T=neg_2)  # -> out, A; inputs x: Double, amp: list of Double, freq: list of Int32, initT: list of Double, T: Double
# ---------- c_script_9: C# ----------
    double y = 0.0;
    //Print(amp.Count.ToString());
    for(int i = 0;i < amp.Count;i++){
      y += amp[i] * Math.Sin(freq[i] * (x + initT[i]+T));

    }
    A = y;
# ---------- end c_script_9 ----------
multiplication_19 = Multiplication(A=pt, B=Slider(1000, range=0..1000))
multiplication_20 = Multiplication(A=pt_2, B=Slider(1000, range=0..1000))
multiplication_21 = Multiplication(A=pt_3, B=Slider(1000, range=0..1000))
multiplication_22 = Multiplication(A=pt_4, B=Slider(1000, range=0..1000))
pt_5 = ConstructPoint(XCoordinate=multiplication_12, YCoordinate=multiplication_13, ZCoordinate=0)
pt_6 = ConstructPoint(XCoordinate=multiplication_14, YCoordinate=multiplication_15, ZCoordinate=0)
sin_9 = Sine(Value=multiplication_18)

multiplication_23 = Multiplication(A=sin_9, B=Slider(1.25, range=0..10))

pt_7 = ConstructPoint(XCoordinate=multiplication_16, YCoordinate=multiplication_17, ZCoordinate=0)
multiplication_24 = Multiplication(A=multiplication_9, B=Slider(167, range=0..10000))

preview = CustomPreview(Geometry=multiplication_19, Material=ColourSwatch(SwatchColor=RGB(255, 255, 255)))

c_script_10 = CSharpScript(x=range_11, amp=merge_11, freq=merge_13, initT=merge_12, T=neg_3)  # -> out, A; inputs x: Double, amp: list of Double, freq: list of Int32, initT: list of Double, T: Double; same code as c_script_9

preview_2 = CustomPreview(Geometry=multiplication_20, Material=ColourSwatch(SwatchColor=RGB(255, 255, 255)))

preview_3 = CustomPreview(Geometry=multiplication_21, Material=ColourSwatch(SwatchColor=RGB(255, 255, 255)))

preview_4 = CustomPreview(Geometry=multiplication_22, Material=ColourSwatch(SwatchColor=RGB(255, 178, 0)))

panel_3 = Panel(c_script_6.out)
pt_8 = ConstructPoint(XCoordinate=range_10, YCoordinate=c_script_6.A, ZCoordinate=0)
panel_4 = Panel(cos_3)
pt_9 = ConstructPoint(XCoordinate=range_14, YCoordinate=c_script_8.A, ZCoordinate=0)
sin_10 = Sine(Value=range_4)
cos_6 = Cosine(Value=range_4)
pt_10 = ConstructPoint(XCoordinate=range_13, YCoordinate=c_script_9.A, ZCoordinate=0)
pt_11 = ConstructPoint(XCoordinate=0, YCoordinate=0, ZCoordinate=0)

preview_5 = CustomPreview(Geometry=pt_5, Material=ColourSwatch(SwatchColor=RGB(255, 255, 255)))

preview_6 = CustomPreview(Geometry=pt_6, Material=ColourSwatch(SwatchColor=RGB(255, 255, 255)))

preview_7 = CustomPreview(Geometry=pt_7, Material=ColourSwatch(SwatchColor=RGB(255, 255, 255)))

sin_11 = Sine(Value=range_8)
cos_7 = Cosine(Value=range_8)
addition_2 = Addition(A=multiplication_24, B=Slider(1000, range=0..1000))
multiplication_25 = Multiplication(A=c_script_7.A, B=Slider(85, range=0..1000))
sin_12 = Sine(Value=range_11)
cos_8 = Cosine(Value=range_11)
sin_13 = Sine(Value=range_12)
cos_9 = Cosine(Value=range_12)
multiplication_26 = Multiplication(A=multiplication_23, B=Slider(167, range=0..10000))
multiplication_27 = Multiplication(A=pt_8, B=Slider(1000, range=0..1000))
ln = Line(StartPoint=pt_11, EndPoint=pt_5)
multiplication_28 = Multiplication(A=pt_9, B=Slider(1000, range=0..1000))
multiplication_29 = Multiplication(A=c_script_10.A, B=Slider(85, range=0..1000))
multiplication_30 = Multiplication(A=pt_10, B=Slider(1000, range=0..1000))
addition_3 = Addition(A=multiplication_25, B=Slider(1000, range=0..1000))
multiplication_31 = Multiplication(A=cos_6, B=addition_3)
multiplication_32 = Multiplication(A=sin_10, B=addition_3)

preview_8 = CustomPreview(Geometry=multiplication_27, Material=ColourSwatch(SwatchColor=RGB(255, 255, 255)))

preview_9 = CustomPreview(Geometry=multiplication_28, Material=ColourSwatch(SwatchColor=RGB(255, 255, 255)))

preview_10 = CustomPreview(Geometry=multiplication_30, Material=ColourSwatch(SwatchColor=RGB(255, 255, 255)))

multiplication_33 = Multiplication(A=cos_9, B=addition_2)
multiplication_34 = Multiplication(A=sin_13, B=addition_2)
addition_4 = Addition(A=multiplication_29, B=Slider(1000, range=0..1000))
multiplication_35 = Multiplication(A=cos_8, B=addition_4)
multiplication_36 = Multiplication(A=sin_12, B=addition_4)
addition_5 = Addition(A=multiplication_26, B=Slider(1000, range=0..1000))
multiplication_37 = Multiplication(A=cos_7, B=addition_5)
multiplication_38 = Multiplication(A=sin_11, B=addition_5)
pt_12 = ConstructPoint(XCoordinate=multiplication_31, YCoordinate=multiplication_32, ZCoordinate=0)
pt_13 = ConstructPoint(XCoordinate=multiplication_37, YCoordinate=multiplication_38, ZCoordinate=0)
pt_14 = ConstructPoint(XCoordinate=multiplication_35, YCoordinate=multiplication_36, ZCoordinate=0)
pt_15 = ConstructPoint(XCoordinate=multiplication_33, YCoordinate=multiplication_34, ZCoordinate=0)
pline = PolyLine(Vertices=pt_12, Closed=Toggle(True))

preview_11 = CustomPreview(Geometry=[pline, pt_12], Material=ColourSwatch(SwatchColor=RGB(255, 255, 255)))

preview_12 = CustomPreview(Geometry=pt_13, Material=ColourSwatch(SwatchColor=RGB(255, 255, 255)))

preview_13 = CustomPreview(Geometry=pt_14, Material=ColourSwatch(SwatchColor=RGB(255, 255, 255)))

preview_14 = CustomPreview(Geometry=pt_15, Material=ColourSwatch(SwatchColor=RGB(255, 255, 255)))

# ----
# xy domain & z=sin(x)+sin(y)
number_slider_13 = Slider(2, range=0..10)
# xy domain & z=sin(theta)
number_slider_14 = Slider(2, range=0..10)

trigger_6 = Trigger(Interval=20, TimerInterval=20, Target=[c_script_11, c_script_13])  # disabled
c_script_11 = CSharpScript(reset=Toggle(False), span=Slider(0.109, range=0..1))  # -> out, T; inputs reset: Boolean, span: Double; same code as c_script

pi_15 = Pi(Factor=number_slider_13)
pi_16 = Pi(Factor=number_slider_14)
merge_14 = Merge(Data1=Slider(8.51, range=0..10), Data2=Slider(5.43, range=0..10), Data3=Slider(0.86, range=0..10))
merge_15 = Merge(Data1=Slider(1.34, range=0..10), Data2=Slider(0.45, range=0..10), Data3=Slider(0.52, range=0..10))
merge_16 = Merge(Data1=Slider(46.09, range=0..100), Data2=Slider(19.65, range=0..100), Data3=Slider(24.06, range=0..100))
merge_17 = Merge(Data1=Slider(1, range=0..10), Data2=Slider(5, range=0..10), Data3=Slider(2, range=0..10))
dom_15 = ConstructDomain(DomainStart=0, DomainEnd=pi_15)
dom_16 = ConstructDomain(DomainStart=0, DomainEnd=pi_16)
neg_4 = Negative(Value=c_script_11.T)

# ---- group: theta
range_15 = Range(Domain=dom_15, Steps=Slider(63, range=0..100))

range_16 = Range(Domain=dom_16, Steps=Slider(100, range=0..100))

# ----
c_script_12 = CSharpScript(x=range_15, amp=merge_15, freq=merge_17, initT=merge_16, T=neg_4, speed=merge_14)  # -> out, A; inputs x: Double, amp: list of Double, freq: list of Int32, initT: list of Double, T: Double, speed: list of Double; same code as c_script_7

c_script_13 = CSharpScript(reset=Toggle(False), span=Slider(0.109, range=0..1))  # -> out, T; inputs reset: Boolean, span: Double; same code as c_script

graft = GraftTree(Tree=range_15, IncludeEmptyLists=True, IncludeNullItems=True)
graft_2 = GraftTree(Tree=range_16, IncludeEmptyLists=True, IncludeNullItems=True)
sin_14 = Sine(Value=range_16)
multiplication_39 = Multiplication(A=c_script_12.A, B=Slider(0.17, range=0..10))
pt_16 = ConstructPoint(XCoordinate=range_16, YCoordinate=graft_2, ZCoordinate=sin_14)
merge_18 = Merge(Data1=Slider(1.44, range=0..10), Data2=Slider(6.07, range=0..10), Data3=Slider(0.86, range=0..10))
merge_19 = Merge(Data1=Slider(2.02, range=0..10), Data2=Slider(0.28, range=0..10), Data3=Slider(0.38, range=0..10))
merge_20 = Merge(Data1=Slider(43.81, range=0..100), Data2=Slider(29.12, range=0..100), Data3=Slider(46.02, range=0..100))
merge_21 = Merge(Data1=Slider(2, range=0..10), Data2=Slider(8, range=0..10), Data3=Slider(4, range=0..10))
neg_5 = Negative(Value=c_script_13.T)
c_script_14 = CSharpScript(x=range_15, amp=merge_19, freq=merge_21, initT=merge_20, T=neg_5, speed=merge_18)  # -> out, A; inputs x: Double, amp: list of Double, freq: list of Int32, initT: list of Double, T: Double, speed: list of Double; same code as c_script_7
graft_3 = GraftTree(Tree=multiplication_39, IncludeEmptyLists=True, IncludeNullItems=True)
multiplication_40 = Multiplication(A=c_script_14.A, B=Slider(0.17, range=0..10))

addition_6 = Addition(A=graft_3, B=multiplication_40)

pt_17 = ConstructPoint(XCoordinate=range_15, YCoordinate=graft, ZCoordinate=addition_6)
viewer = ParamViewer(multiplication_40)
multiplication_41 = Multiplication(A=pt_16, B=Slider(1000, range=0..1000))
pdecon = Deconstruct(Point=pt_17)  # -> XComponent, YComponent, ZComponent
panel_5 = Panel(multiplication_41)
flatten = FlattenTree(Tree=pdecon.ZComponent, Path="{0}")
flatten_2 = FlattenTree(Tree=pt_17, Path="{0}")
bnd = Bounds(Numbers=flatten)
remap = RemapNumbers(Value=flatten, Source=bnd, Target=Domain(0, 1))  # -> Mapped, Clipped
multiplication_42 = Multiplication(A=pt_17, B=Slider(1000, range=0..1000))
gradient = Gradient(
    LowerLimit=0,
    UpperLimit=1,
    Parameter=remap.Mapped,
    stops=[0.186: RGB(75, 107, 169), 0.752: RGB(173, 203, 249), 0.958: RGB(255, 255, 255)])
preview_15 = CustomPreview(Geometry=flatten_2, Material=gradient)
