# Grasshopper definition SineWave on Sphere.gh (Grasshopper 1.0.7)

number_slider = Slider(61, range=0..100)
mesh_sphere_ex = MeshSphereEx(Base=PlaneXY(0, 0, 0), Radius=number_slider, Count=Slider(45, range=0..100))
number = Number(number_slider)
populate_geometry = PopulateGeometry(Geometry=mesh_sphere_ex, Count=Slider(3, range=0..10), Seed=1)
deconstruct_mesh = DeconstructMesh(Mesh=mesh_sphere_ex)  # -> Vertices, Faces, Colours, Normals
graft_tree = GraftTree(Tree=deconstruct_mesh.Vertices, IncludeEmptyLists=True, IncludeNullItems=True)
distance = Distance(PointA=graft_tree, PointB=populate_geometry)
flatten_tree = FlattenTree(Tree=distance, Path="{0}")
trigger = Trigger(TimerInterval=5, Target=counter)
division = Division(A=distance, B=Slider(2, range=0..10))
division_2 = Division(A=division, B=number)
multiplication = Multiplication(A=number, B=Slider(2, range=0..10))
panel = Panel(flatten_tree)
counter = Counter(Reset=1)  # -> out, a
# ---------- counter: Python ----------
__author__ = "pc"
__version__ = "2020.04.03"

import rhinoscriptsyntax as rs
try:
    t+=1
except:
    t=0
t=t*Reset
a=t
# ---------- end counter ----------
arcsine = ArcSine(Value=division_2)
multiplication_2 = Multiplication(A=arcsine, B=multiplication)
# for generating GIF
pi = Pi(Factor=Slider(2, range=0..10))
multiplication_3 = Multiplication(A=counter.a, B=Slider(0.1, range=0..0.1))
multiplication_4 = Multiplication(A=multiplication_2, B=Slider(0.214, range=0..1))
panel_2 = Panel(multiplication_2)
multiplication_5 = Multiplication(A=pi, B=Slider(1, range=0..1))
addition = Addition(A=multiplication_4, B=multiplication_5)
sine = Sine(Value=addition)
multiplication_6 = Multiplication(A=sine, B=Slider(3.44, range=0..100))
mass_addition = MassAddition(Input=multiplication_6)  # -> Result, PartialResults
flatten_tree_2 = FlattenTree(Tree=mass_addition.Result, Path="{0}")
multiplication_7 = Multiplication(A=deconstruct_mesh.Normals, B=flatten_tree_2)
move = Move(Geometry=deconstruct_mesh.Vertices, Motion=multiplication_7)  # -> Geometry, Transform
construct_mesh = ConstructMesh(Vertices=move.Geometry, Faces=deconstruct_mesh.Faces, Colours=deconstruct_mesh.Normals)
deconstruct_mesh_2 = DeconstructMesh(Mesh=construct_mesh)  # -> Vertices, Faces, Colours, Normals
bounddomain = Bounddomain(numbers=flatten_tree_2)  # -> start, end
bounds = Bounds(Numbers=flatten_tree_2)
construct_mesh_2 = ConstructMesh(Vertices=deconstruct_mesh_2.Vertices, Faces=deconstruct_mesh_2.Faces, Colours=deconstruct_mesh_2.Normals)
number_slider_2 = Slider(10, range=0..10)
deconstruct_mesh_3 = DeconstructMesh(Mesh=construct_mesh_2)  # -> Vertices, Faces, Colours, Normals
split_ahsv = SplitAHSV(Colour=deconstruct_mesh_3.Colours)  # -> Alpha, Hue, Saturation, Value
remap_numbers = RemapNumbers(Value=flatten_tree_2, Source=bounds, Target=Domain(0, 1))  # -> Mapped, Clipped
power = Power(A=remap_numbers.Mapped, B=Slider(3.27, range=0..100))
multiplication_8 = Multiplication(A=split_ahsv.Hue, B=Slider(0.7435, range=0..1))
addition_2 = Addition(A=power, B=Slider(0.21, range=0..10))
subtraction = Subtraction(A=remap_numbers.Mapped, B=Slider(0.46, range=0..1))
colour_hsv = ColourHSV(Alpha=subtraction, Hue=multiplication_8, Saturation=Slider(0.24, range=0..1), Value=addition_2)
construct_mesh_3 = ConstructMesh(Vertices=deconstruct_mesh_3.Vertices, Faces=deconstruct_mesh_3.Faces, Colours=colour_hsv)

# ==== cluster Bounddomain: bounddomain
numbers = ClusterInput()
bounds = Bounds(Numbers=numbers)
deconstruct_domain = DeconstructDomain(Domain=bounds)  # -> Start, End
start = ClusterOutput(deconstruct_domain.Start)
end = ClusterOutput(deconstruct_domain.End)
